# Grasshopper definition AssemblyKit_mod.gh (Grasshopper 0.9.76)

# ----
# Defining notch size and shape
length = Slider(9.42, range=0..100)
notch_width = Slider(4.2, range=0..100)
triangle_size = Slider(4.3, range=0..10)
rectangle = Rectangle(Plane=PlaneXY(0, 0, 0), XSize=length, YSize=notch_width, Radius=0)  # -> Rectangle, Length
polygon = Polygon(Plane=PlaneXY(0, 0, 0), Radius=triangle_size, Segments=3, FilletRadius=0)  # -> Polygon, Length
explode = Explode(Curve=polygon.Polygon, Recursive=True)  # -> Segments, Vertices
bbox = BoundingBox(Content=rectangle.Rectangle, Plane=PlaneXY(0, 0, 0))  # -> Box, Box_2
item = ListItem(List=explode.Segments, Index=0, Wrap=True)
debrep = DeconstructBrep(Brep=bbox.Box)  # -> Faces, Edges, Vertices
hframe = HorizontalFrame(Curve=reparameterize(item), Parameter=0.5)
evalsrf = EvaluateSurface(Surface=reparameterize(debrep.Faces), Point="{0,0.5,0}")  # -> Point, Normal, Frame
prot = RotatePlane(Plane=evalsrf.Frame, Angle=3.141592654)
prot_2 = RotatePlane(Plane=hframe, Angle=1.570796327)
orient = Orient(Geometry=polygon.Polygon, Source=prot_2, Target=evalsrf.Point)  # -> Geometry, Transform
runion = RegionUnion(Curves=flatten([rectangle.Rectangle, orient.Geometry]))

# ----
# Defining construction kit shape
number_of_sides = Slider(3, range=3..10)
polygon_radii = Slider(27, range=0..100)
polygon_2 = Polygon(Plane=PlaneXY(0, 0, 0), Radius=polygon_radii, Segments=number_of_sides, FilletRadius=0)  # -> Polygon, Length
move = Move(Geometry=polygon_2.Polygon, Motion=Vector(0, 29.86743711, 0))  # -> Geometry, Transform
explode_2 = Explode(Curve=move.Geometry, Recursive=True)  # -> Segments, Vertices
hframe_2 = HorizontalFrame(Curve=reparameterize(explode_2.Segments), Parameter=Slider(0.5, range=0..1))
prot_3 = RotatePlane(Plane=hframe_2, Angle=1.570796327)
multiplication = Multiplication(A=Slider(270, range=0..360), B=0.01745329252)
prot_4 = RotatePlane(Plane=hframe_2, Angle=multiplication)

multiplication_2 = Multiplication(A=notch_width, B=0.7071067812)

orient_2 = Orient(Geometry=rectangle.Rectangle, Source=evalsrf.Frame, Target=prot_4)  # -> Geometry, Transform
runion_2 = RegionUnion(Curves=flatten([orient_2.Geometry, move.Geometry]))
pcen = PolygonCenter(Polyline=runion_2)  # -> CenterV, CenterE, CenterA
circle = CircleCNR(Center=pcen.CenterV, Normal=Vector(0, 0, 1), Radius=multiplication_2)
group = Group(Objects=[circle, runion_2])

orient_3 = Orient(Geometry=runion, Source=prot, Target=prot_4)  # -> Geometry, Transform
rdiff = RegionDifference(CurvesA=move.Geometry, CurvesB=orient_3.Geometry)
pcen_2 = PolygonCenter(Polyline=rdiff)  # -> CenterV, CenterE, CenterA
circle_2 = CircleCNR(Center=pcen_2.CenterV, Normal=Vector(0, 0, 1), Radius=multiplication_2)
group_2 = Group(Objects=[circle_2, rdiff])

panel = Panel("""-4
-1
2
5""")
multiplication_3 = Multiplication(A=number_of_sides, B=20)
multiplication_4 = Multiplication(A=polygon_radii, B=panel)
pt = ConstructPoint(XCoordinate=multiplication_4, YCoordinate=multiplication_3, ZCoordinate=0)
ln = Line(StartPoint="{0,0,0}", EndPoint=pt)

panel_2 = Panel("arc dimension parameters")
arc_length = Slider(27, range=0..100)
arc_angle = Slider(90, range=0..360)
multiplication_5 = Multiplication(A=arc_angle, B=0.01745329252)
arc = Arc(Plane=PlaneXY(0, 0, 0), Radius=arc_length, Angle=multiplication_5)  # -> Arc, Length
division = Division(A=polygon_radii, B=2)
offset = Offset(Curve=arc.Arc, Distance=division, Plane=PlaneXY(0, 0, 0), Corners=1)
loft = Loft(
    Curves=flatten([arc.Arc, offset]),
    Options={Adjust=False, Closed=False, LoftEnds=0, LoftSimp=0, LoftType=0, Rebuild=10, Refit=0.01})
position_on_arc = Slider(0.5, range=0..1)
debrep_2 = DeconstructBrep(Brep=loft)  # -> Faces, Edges, Vertices
item_2 = ListItem(List=debrep_2.Edges, Index=2, Wrap=True)
hframe_3 = HorizontalFrame(Curve=reparameterize(item_2), Parameter=position_on_arc)

multiplication_6 = Multiplication(A=Slider(325, range=0..360), B=0.01745329252)

prot_5 = RotatePlane(Plane=hframe_3, Angle=multiplication_6)

orient_4 = Orient(Geometry=runion_2, Source=pcen_2.CenterV, Target=prot_5)  # -> Geometry, Transform
pcen_3 = PolygonCenter(Polyline=orient_4.Geometry)  # -> CenterV, CenterE, CenterA
runion_3 = RegionUnion(Curves=flatten([orient_4.Geometry, loft]))
orient_5 = Orient(Geometry=circle, Source=pcen_2.CenterV, Target=pcen_3.CenterV)  # -> Geometry, Transform
group_3 = Group(Objects=flatten([orient_5.Geometry, runion_3]))

orient_6 = Orient(Geometry=rdiff, Source=pcen_2.CenterV, Target=prot_5)  # -> Geometry, Transform
runion_4 = RegionUnion(Curves=flatten([orient_6.Geometry, loft]))
pcen_4 = PolygonCenter(Polyline=orient_6.Geometry)  # -> CenterV, CenterE, CenterA
orient_7 = Orient(Geometry=circle_2, Source=pcen_2.CenterV, Target=pcen_4.CenterV)  # -> Geometry, Transform
group_4 = Group(Objects=flatten([orient_7.Geometry, runion_4]))

move_2 = Move(Geometry=flatten([group_2, group, group_3, group_4]), Motion=ln)  # -> Geometry, Transform
